# Grasshopper definition gh_palmeta.gh (Grasshopper 1.0.7)
# plug-ins: Pufferfish

# ---- group: PARAMETROS
lado_box = Slider(60, range=0..100)
altura_box = Slider(7, range=0..25)
on_off = BooleanToggle(False)

# ----
num = Number(expr("x*10", lado_box))
num_2 = Number(expr("x*10", altura_box))
xy = XYPlane(Origin=Point(0, 0, 0))
rectangle = Rectangle(Plane=PlaneXY(0, 0, 0), XSize=num, YSize=num, Radius=0)  # -> Rectangle, Length
planesrf = PlaneSurface(Plane=xy, XSize=num, YSize=num)
divide = DivideDomain²(Domain=planesrf, UCount=10, VCount=10)

# ---- group: PALMETA
boxrec = BoxRectangle(Rectangle=rectangle.Rectangle, Height=num_2)

# ---- group: SUPERFICIE
brep = Brep(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)
area = Area(Geometry=brep)  # -> Area, Centroid

# ----
subsrf = Isotrim(Surface=planesrf, Domain=divide)
area_2 = Area(Geometry=subsrf)  # -> Area, Centroid
move2pt = MoveToPoint(Geometry=brep, PointA=area.Centroid, PointB=area_2.Centroid)  # -> Moved, Vector, Transform
Z = UnitZ(Factor=num_2)
move = Move(Geometry=move2pt.Moved, Motion=Z)  # -> Geometry, Transform
cap = CapHoles(Brep=move.Geometry)
sunion = SolidUnion(Breps=cap)
filter = StreamFilter(Gate=on_off, Stream1=sunion)

# ---- group: MOLDE
sdiff = SolidDifference(BrepsA=boxrec, BrepsB=filter)
